# Grasshopper definition PhD_TBIM_2DCurvesOptimizer.gh (Grasshopper 1.0.7)

# ----
# Curves to adjust from Rhino
curves_to_adjust = Curve([<curve referenced from the Rhino model> x35])

# ----
# Base level curves from Rhino
base_level_curves = Curve([<curve referenced from the Rhino model> x13])

simplify = SimplifyCurve(Curve=curves_to_adjust)  # -> Curve, Simplified

item = ListItem(List=simplify.Curve, Index=0, Wrap=True)
bbox = BoundingBox(Content=base_level_curves, Plane=PlaneXY(0, 0, 0), UnionBox=True)  # -> Box, Box_2
area = Area(Geometry=item)  # -> Area, Centroid
srf = Surface(bbox.Box)
xy = XYPlane(Origin=area.Centroid)
project = Project(Geometry=srf, Plane=xy)  # -> Geometry, Transform
explode = Explode(Curve=project.Geometry, Recursive=True)  # -> Segments, Vertices
item_2 = ListItem(List=explode.Segments, Index=0, Wrap=True)  # -> Item, Item1
len = Length(Curve=item_2.Item)
len_2 = Length(Curve=item_2.Item1)
division = Division(A=len, B="200")
division_2 = Division(A=len_2, B="200")
int = Integer(division)
int_2 = Integer(division_2)
mesh_uv = MeshSurface(Surface=project.Geometry, UCount=int_2, VCount=int, Overhang=True, Equalize=False)
faceb = FaceBoundaries(Mesh=mesh_uv)
area_2 = Area(Geometry=faceb)  # -> Area, Centroid
multiplication = Multiplication(A="200", B="0.75")
explode_2 = Explode(Curve=simplify.Curve, Recursive=True)  # -> Segments, Vertices
cullpt = CullDuplicates(Points=flatten(explode_2.Vertices), Tolerance=0.1, CullMode=3)  # -> Points, Indices, Valence
cp = ClosestPoint(Point=area_2.Centroid, Cloud=cullpt.Points)  # -> ClosestPoint, CPIndex, Distance
smaller = SmallerThan(FirstNumber=cp.Distance, SecondNumber=multiplication)  # -> SmallerThan, OrEqualTo
dispatch = Dispatch(List=faceb, DispatchPattern=smaller.SmallerThan)  # -> ListA, ListB
srf_2 = Surface(dispatch.ListA)
mesh_uv_2 = MeshSurface(Surface=srf_2, UCount="4", VCount="4", Overhang=True, Equalize=False)
mjoin = MeshJoin(Meshes=flatten(mesh_uv_2))
faceb_2 = FaceBoundaries(Mesh=mjoin)
division_3 = Division(A="200", B="4")
multiplication_2 = Multiplication(A=division_3, B=2)
area_3 = Area(Geometry=faceb_2)  # -> Area, Centroid
cp_2 = ClosestPoint(Point=area_3.Centroid, Cloud=cullpt.Points)  # -> ClosestPoint, CPIndex, Distance
multiplication_3 = Multiplication(A=multiplication_2, B=0.75)
smaller_2 = SmallerThan(FirstNumber=cp_2.Distance, SecondNumber=multiplication_3)  # -> SmallerThan, OrEqualTo
dispatch_2 = Dispatch(List=faceb_2, DispatchPattern=smaller_2.SmallerThan)  # -> ListA, ListB
srf_3 = Surface(dispatch_2.ListA)
mesh_uv_3 = MeshSurface(Surface=srf_3, UCount="5", VCount="5", Overhang=True, Equalize=False)
mjoin_2 = MeshJoin(Meshes=flatten(mesh_uv_3))
faceb_3 = FaceBoundaries(Mesh=mjoin_2)
area_4 = Area(Geometry=faceb_3)  # -> Area, Centroid
cp_3 = ClosestPoint(Point=area_4.Centroid, Cloud=cullpt.Points)  # -> ClosestPoint, CPIndex, Distance
smaller_3 = SmallerThan(FirstNumber=cp_3.Distance, SecondNumber="15")  # -> SmallerThan, OrEqualTo
dispatch_3 = Dispatch(List=faceb_3, DispatchPattern=smaller_3.SmallerThan)  # -> ListA, ListB
srf_4 = Surface(dispatch_3.ListA)
area_5 = Area(Geometry=srf_4)  # -> Area, flatten(Centroid)
explode_3 = Explode(Curve=simplify.Curve, Recursive=True)  # -> Segments, Vertices
cp_4 = ClosestPoint(Point=explode_3.Vertices, Cloud=area_5.Centroid)  # -> ClosestPoint, CPIndex, Distance
pline = PolyLine(Vertices=cp_4.ClosestPoint, Closed=False)

# ----
# Adjusted Curves
adjusted_curves = Curve(flatten(pline))

panel = Panel(pline)
